# Dynamo graph graph-contract.dyn "Original two-input Python contract fixture" (Dynamo 2.12.1.8246)
# Original synthetic static fixture. Documented engine: IronPython2 (IronPython 2.7). Never runtime tested.

node = (Value=2)
node_2 = (Value=3)
python = Python(IN[0]=node, IN[1]=node_2)  # IronPython2
# ---------- python.python (5 lines) ----------
# Original fixture; shared Python 2.7 / 3 syntax.
# Engine: IronPython2. One output port carries a two-item list.
left = IN[0]
right = IN[1]
OUT = [left + right, left * right]
# ----------------------------------------
node_3 = (value=python)
